# Grasshopper definition columns workflow.ghx (Grasshopper 1.0.7)
# plug-ins: Speckle 2

panel = Panel("https://macad.speckle.xyz/projects/af5d09c237/models/0aa2d6f0aa")

# ---- group: receive from residential team / RH_IN:Send
txt = Text()

# ---- group: receive from residential team
synchronous_receiver = SynchronousReceiver(
    Stream=txt,
    AutoReceive=False,
    ReceivedObjectId="fe8a71d9ca2d25c843297a561bd139f1",
    StreamWrapper="https://macad.speckle.xyz/projects/af5d09c237/models/0aa2d6f0aa",
    selectedKitName="Objects")  # -> Data, Info

# ----
receive = Receive(
    Stream=panel,
    AutoReceive=False,
    CurrentComponentState="expired",
    ExpandOutput=True,
    LastInfoMessage="ERVA Hofi @ 03/23/2025 15:04:30: Pushed 571 elements from Grasshopper. (id:1d42d6e789)",
    ReceiveOnOpen=False,
    ReceivedCommitId="1d42d6e789",
    StreamWrapper="https://macad.speckle.xyz/projects/af5d09c237/models/floorplates_v1",
    selectedKitName="Objects")  # -> Info, Data
pt = Point(synchronous_receiver.Data)
intcrv = Interpolate(Vertices=pt, Degree=Slider(1, range=0..3), Periodic=Toggle(True), KnotStyle=1)  # -> Curve, Length, Domain
surface = Surface(graft(intcrv.Curve))
radius_bottom = Slider(26, range=10..30)
is_planar = IsPlanar(Surface=surface, Interior=True)  # -> Planar, Plane
of_columns_main_beams = Slider(10, range=0..30)
radius_top = Slider(16, range=10..20)
project = Project(Geometry=surface, Plane=is_planar.Plane)  # -> Geometry, Transform
area = Area(Geometry=project.Geometry)  # -> Area, graft(Centroid)
list_item = ListItem(List=flatten(area.Centroid), Index=0, Wrap=True)  # -> Item1, Item
# Towers Structural System
circle = Circle(Plane=list_item.Item1, Radius=radius_top)
circle_2 = Circle(Plane=list_item.Item, Radius=radius_bottom)
divide_curve = DivideCurve(Curve=circle, Count=of_columns_main_beams, Kinks=False)  # -> Points, Tangents, Parameters
divide_curve_2 = DivideCurve(Curve=circle_2, Count=of_columns_main_beams, Kinks=False)  # -> Points, Tangents, Parameters
surface_2 = Surface(flatten(surface))
line = Line(StartPoint=divide_curve.Points, EndPoint=divide_curve_2.Points)
panel_2 = Panel("""0
-1""")
cull_index = CullIndex(List=surface_2, Indices=panel_2, Wrap=True)  # -> graft(List)
split_with_breps = SplitWithBreps(Curve=line, Brep=flatten(cull_index))  # -> Curve, Points
flip_matrix = FlipMatrix(Data=split_with_breps.Curve)
item = ListItem(List=flatten(split_with_breps.Curve), Index=0, Wrap=True)
len = Length(Curve=item)

# ---- group: Loads calculation
series = Series(Start="1", Step=1, Count="47")
eval = Evaluate(F="3*((2+(N-2)*0.7)/N)", N=series)
ma = MassAddition(Input=eval)  # -> Result, PartialResults
total_load_kn = Panel(ma.Result)
kn_floor = Panel(eval)
sum_of_kn_floor = Panel(ma.PartialResults)
panel_3 = Panel(sum_of_kn_floor)
multiplication = Multiplication(A=panel_3, B="10000")
expression = Expression(P=multiplication, Expression="Sqrt(P / (10^7))")
panel_4 = Panel(expression)

# ----
curve = Curve(flip_matrix)
panel_5 = Panel(len)
division = Division(A=len, B="500")
panel_6 = Panel(division)
multiplication_2 = Multiplication(A=division, B="1000")

# ---- group: Displacement Calculation
multiplication_3 = Multiplication(A=panel_4, B=Slider(1.5, range=0..10))
num = Number(multiplication)
multiplication_4 = Multiplication(A=multiplication_3, B="100")
expression_2 = Expression(P=num, L=multiplication_4, b=multiplication_3, E="20e9", Expression="(P * L) / (b^2 * E)")
panel_7 = Panel(multiplication_3)
panel_8 = Panel(expression_2)
multiplication_5 = Multiplication(A=panel_8, B="1000")
panel_9 = Panel(multiplication_5)
item_2 = ListItem(List=panel_9, Index="-1", Wrap=True)

# ---- group: Columns Creator
len_2 = Length(Curve=curve)
item_3 = ListItem(List=len_2, Index=0, Wrap=True)
rectangle = Rectangle(Plane=curve, XSize=graft(multiplication_3), YSize=graft(multiplication_3), Radius=0)  # -> Rectangle, Length
neg = Negative(Value=item_3)
Z = UnitZ(Factor=neg)
srf = Surface(rectangle.Rectangle)
extr = Extrude(Base=srf, Direction=Z)

# ---- group: Displacement NO.
panel_10 = Panel(item_2)

# ----
panel_11 = Panel(multiplication_2)
larger = LargerThan(FirstNumber=panel_10, SecondNumber=panel_11)  # -> LargerThan, OrEqualTo
panel_12 = Panel(larger.OrEqualTo)
bool = Boolean(panel_12)
# First Check of the displacement NO.
# If the displacement NO. is larger than the allowable range send it to the next script,
# if it's smaller than the range send the columns to STRUCUTRE PROJECT IN SPECKLE
cso = CreateSpeckleObject(A=extr, selectedKitName="Objects")

# ---- group: In range, send it to the STRUCTURE PROJECT
# change "project" for "streams": https://macad.speckle.xyz/streams/a63c4e60ed
cso_2 = CreateSpeckleObject(selectedKitName="Objects")
panel_13 = Panel("Receive_From_Compute Stream")
panel_14 = Panel("Bot Speckle Token")
txt_2 = Text()
sgetwt = StreamGetWithToken(Stream=txt_2, AuthToken="0a7a2c01a136ad89e2cfa5e002c9f1bcbe5656a1d0")
ss = SynchronousSender(
    Data=cso,
    Stream=sgetwt,
    OutputWrappers="https://macad.speckle.xyz\t27b32e7bd2\tab5404b2dc",
    UseDefaultCache=True,
    selectedKitName="Objects")
